# Dynamo graph 4_1_1_개별정보추출.dyn "2 extracting id_classname" (Dynamo 2.10.1.3976)

file_path = Filename("새 폴더\features.csv")
select_model_elements = DSModelElementsSelection()  # 5195 picked in the model
uniqueId = Element.UniqueId(element=select_model_elements)
getCategory = Element.GetCategory(element=select_model_elements)
string_from_object = FromObject(object=getCategory)
categories = Categories("OST_Walls")
string_from_object_2 = FromObject(object=categories)
contains = String.Contains(str=string_from_object@L1, searchFor=string_from_object_2)
filterByBoolMask = List.FilterByBoolMask(list=uniqueId, mask=contains)
code_block = CodeBlock { ","; }
add = filterByBoolMask.in + code_block
filterByBoolMask_2 = List.FilterByBoolMask(list=select_model_elements, mask=contains)
code_block_2 = CodeBlock { "BH_NAME"; }
getParameterValueByName = Element.GetParameterValueByName(element=filterByBoolMask_2.in, parameterName=code_block_2)
code_block_3 = CodeBlock { "_"; }
split = String.Split(str=getParameterValueByName, separator0=code_block_3)
lastItem = List.LastItem(list=split@L2)
add_2 = add + lastItem
code_block_4 = CodeBlock { ","; }
add_3 = add_2 + code_block_4
code_block_5 = CodeBlock { -1; 1; }
substring = String.Substring(str=lastItem, startIndex=code_block_5.out0, length=code_block_5.out1)
add_4 = add_3 + substring
element_by_id = ElementById(Id=filterByBoolMask.out)
uniqueId_2 = Element.UniqueId(element=element_by_id)
getCategory_2 = Element.GetCategory(element=element_by_id)
string_from_object_3 = FromObject(object=getCategory_2)
categories_2 = Categories("OST_StructuralFraming")
string_from_object_4 = FromObject(object=categories_2)
contains_2 = String.Contains(str=string_from_object_3@L1, searchFor=string_from_object_4)
filterByBoolMask_3 = List.FilterByBoolMask(list=uniqueId_2, mask=contains_2)
code_block_6 = CodeBlock { ","; }
add_5 = filterByBoolMask_3.in + code_block_6
filterByBoolMask_4 = List.FilterByBoolMask(list=element_by_id, mask=contains_2)
name = Family.Name(family=filterByBoolMask_4.in)
code_block_7 = CodeBlock { "_"; }
split_2 = String.Split(str=name, separator0=code_block_7)
lastItem_2 = List.LastItem(list=split_2@L2)
add_6 = add_5 + lastItem_2
code_block_8 = CodeBlock { ","; }
add_7 = add_6 + code_block_8
code_block_9 = CodeBlock { -1; 1; }
substring_2 = String.Substring(str=lastItem_2, startIndex=code_block_9.out0, length=code_block_9.out1)
add_8 = add_7 + substring_2
element_by_id_2 = ElementById(Id=filterByBoolMask_3.out)
uniqueId_3 = Element.UniqueId(element=element_by_id_2)
getCategory_3 = Element.GetCategory(element=element_by_id_2)
string_from_object_5 = FromObject(object=getCategory_3)
categories_3 = Categories("OST_Floors")
string_from_object_6 = FromObject(object=categories_3)
contains_3 = String.Contains(str=string_from_object_5@L1, searchFor=string_from_object_6)
filterByBoolMask_5 = List.FilterByBoolMask(list=uniqueId_3, mask=contains_3)
code_block_10 = CodeBlock { ", "; }
add_9 = filterByBoolMask_5.in + code_block_10
filterByBoolMask_6 = List.FilterByBoolMask(list=element_by_id_2, mask=contains_3)
code_block_11 = CodeBlock { "BH_NAME"; }
getParameterValueByName_2 = Element.GetParameterValueByName(element=filterByBoolMask_6.in, parameterName=code_block_11)
code_block_12 = CodeBlock { "_"; }
split_3 = String.Split(str=getParameterValueByName_2, separator0=code_block_12)
lastItem_3 = List.LastItem(list=split_3@L2)
add_10 = add_9 + lastItem_3
code_block_13 = CodeBlock { ", "; }
add_11 = add_10 + code_block_13
code_block_14 = CodeBlock { -1; 1; }
substring_3 = String.Substring(str=lastItem_3, startIndex=code_block_14.out0, length=code_block_14.out1)
add_12 = add_11 + substring_3
element_by_id_3 = ElementById(Id=filterByBoolMask_5.out)
uniqueId_4 = Element.UniqueId(element=element_by_id_3)
getCategory_4 = Element.GetCategory(element=element_by_id_3)
string_from_object_7 = FromObject(object=getCategory_4)
categories_4 = Categories("OST_StairsLandings")
string_from_object_8 = FromObject(object=categories_4)
contains_4 = String.Contains(str=string_from_object_7@L1, searchFor=string_from_object_8)
filterByBoolMask_7 = List.FilterByBoolMask(list=uniqueId_4, mask=contains_4)
code_block_15 = CodeBlock { ", "; }
add_13 = filterByBoolMask_7.in + code_block_15
filterByBoolMask_8 = List.FilterByBoolMask(list=element_by_id_3, mask=contains_4)
getParentElement = Element.GetParentElement(element=filterByBoolMask_8.in)
code_block_16 = CodeBlock { "BH_NAME"; }
getParameterValueByName_3 = Element.GetParameterValueByName(element=getParentElement, parameterName=code_block_16)
code_block_17 = CodeBlock { "_"; }
split_4 = String.Split(str=getParameterValueByName_3, separator0=code_block_17)
lastItem_4 = List.LastItem(list=split_4@L2)
add_14 = add_13 + lastItem_4
code_block_18 = CodeBlock { ", "; }
add_15 = add_14 + code_block_18
code_block_19 = CodeBlock { -2; 2; }
substring_4 = String.Substring(str=lastItem_4, startIndex=code_block_19.out0, length=code_block_19.out1)
add_16 = add_15 + substring_4
element_by_id_4 = ElementById(Id=filterByBoolMask_7.out)
uniqueId_5 = Element.UniqueId(element=element_by_id_4)
getCategory_5 = Element.GetCategory(element=element_by_id_4)
string_from_object_9 = FromObject(object=getCategory_5)
categories_5 = Categories("OST_StairsRuns")
string_from_object_10 = FromObject(object=categories_5)
contains_5 = String.Contains(str=string_from_object_9@L1, searchFor=string_from_object_10)
filterByBoolMask_9 = List.FilterByBoolMask(list=uniqueId_5, mask=contains_5)
code_block_20 = CodeBlock { ", "; }
add_17 = filterByBoolMask_9.in + code_block_20
filterByBoolMask_10 = List.FilterByBoolMask(list=element_by_id_4, mask=contains_5)
getParentElement_2 = Element.GetParentElement(element=filterByBoolMask_10.in)
code_block_21 = CodeBlock { "BH_NAME"; }
getParameterValueByName_4 = Element.GetParameterValueByName(element=getParentElement_2, parameterName=code_block_21)
code_block_22 = CodeBlock { "_"; }
split_5 = String.Split(str=getParameterValueByName_4, separator0=code_block_22)
lastItem_5 = List.LastItem(list=split_5@L2)
add_18 = add_17 + lastItem_5
code_block_23 = CodeBlock { ", "; }
add_19 = add_18 + code_block_23
code_block_24 = CodeBlock { -2; 2; }
substring_5 = String.Substring(str=lastItem_5, startIndex=code_block_24.out0, length=code_block_24.out1)
add_20 = add_19 + substring_5
element_by_id_5 = ElementById(Id=filterByBoolMask_9.out)
uniqueId_6 = Element.UniqueId(element=element_by_id_5)
getCategory_6 = Element.GetCategory(element=element_by_id_5)
string_from_object_11 = FromObject(object=getCategory_6)
categories_6 = Categories("OST_StructuralColumns")
string_from_object_12 = FromObject(object=categories_6)
contains_6 = String.Contains(str=string_from_object_11@L1, searchFor=string_from_object_12)
filterByBoolMask_11 = List.FilterByBoolMask(list=uniqueId_6, mask=contains_6)
code_block_25 = CodeBlock { ", "; }
add_21 = filterByBoolMask_11.in + code_block_25
filterByBoolMask_12 = List.FilterByBoolMask(list=element_by_id_5, mask=contains_6)
code_block_26 = CodeBlock { "BH_NAME"; }
getParameterValueByName_5 = Element.GetParameterValueByName(element=filterByBoolMask_12.in, parameterName=code_block_26)
code_block_27 = CodeBlock { "_"; }
split_6 = String.Split(str=getParameterValueByName_5, separator0=code_block_27)
lastItem_6 = List.LastItem(list=split_6@L2)
add_22 = add_21 + lastItem_6
code_block_28 = CodeBlock { ", "; }
add_23 = add_22 + code_block_28
code_block_29 = CodeBlock { -1; 1; }
substring_6 = String.Substring(str=lastItem_6, startIndex=code_block_29.out0, length=code_block_29.out1)
add_24 = add_23 + substring_6
element_by_id_6 = ElementById(Id=filterByBoolMask_11.out)
uniqueId_7 = Element.UniqueId(element=element_by_id_6)
getCategory_7 = Element.GetCategory(element=element_by_id_6)
string_from_object_13 = FromObject(object=getCategory_7)
categories_7 = Categories("OST_StructuralFoundation")
string_from_object_14 = FromObject(object=categories_7)
contains_7 = String.Contains(str=string_from_object_13@L1, searchFor=string_from_object_14)
filterByBoolMask_13 = List.FilterByBoolMask(list=uniqueId_7, mask=contains_7)
code_block_30 = CodeBlock { ", "; }
add_25 = filterByBoolMask_13.in + code_block_30
filterByBoolMask_14 = List.FilterByBoolMask(list=element_by_id_6, mask=contains_7)
code_block_31 = CodeBlock { "BH_NAME"; }
getParameterValueByName_6 = Element.GetParameterValueByName(element=filterByBoolMask_14.in, parameterName=code_block_31)
code_block_32 = CodeBlock { "_"; }
split_7 = String.Split(str=getParameterValueByName_6, separator0=code_block_32)
lastItem_7 = List.LastItem(list=split_7@L2)
add_26 = add_25 + lastItem_7
code_block_33 = CodeBlock { ", "; }
add_27 = add_26 + code_block_33
code_block_34 = CodeBlock { -1; 1; }
substring_7 = String.Substring(str=lastItem_7, startIndex=code_block_34.out0, length=code_block_34.out1)
add_28 = add_27 + substring_7
join = List.Join(list0=add_4, list1=add_8, list2=add_12, list3=add_16, list4=add_20, list5=add_24, list6=add_28)
exportCSV = Data.ExportCSV(filePath=file_path, data=join)
