# Dynamo graph 4_1_2_1_계단객체들GUID쌍.dyn "1 group model 안의 계단들 위로 이어 연결 edge 뽑기" (Dynamo 2.10.1.3976)
# packages: SteamNodes 1.2.4

categories = Categories("OST_IOSModelGroups")
all_elements_of_category = ElementsOfCategory(Category=categories)
getMembers = Group.GetMembers(group=all_elements_of_category)
flatten = List.Flatten(list=getMembers)
typeName = Custom[Element.TypeName](Elements=flatten@L1)  # package SteamNodes; Get Type Name as string
element_types = ElementTypes("StairsRun")
string_from_array = FromArray(array=element_types)
eq = typeName@L1 == string_from_array
filterByBoolMask = List.FilterByBoolMask(list=flatten, mask=eq)
element_types_2 = ElementTypes("StairsLanding")
string_from_array_2 = FromArray(array=element_types_2)
eq_2 = typeName@L1 == string_from_array_2
filterByBoolMask_2 = List.FilterByBoolMask(list=flatten, mask=eq_2)
list_create = List.Create(item0=filterByBoolMask.in, item1=filterByBoolMask_2.in)
flatten_2 = List.Flatten(list=list_create)
geometry = Element.Geometry(element=flatten_2)
byGeometry = BoundingBox.ByGeometry(geom=geometry)
toCuboid = BoundingBox.ToCuboid(boundingBox=byGeometry)
maxPoint = BoundingBox.MaxPoint(boundingBox=byGeometry)
XY = Plane.XY()
code_block = CodeBlock { 0; -1; }
byCoordinates = Vector.ByCoordinates(x=code_block.out0, y=code_block.out0, z=code_block.out1)
project = Point.Project(point=maxPoint, baseGeometry=XY, projectionDirection=byCoordinates)
flatten_3 = List.Flatten(list=project)
K = CodeBlock { 2; }
python_script = Python(IN[0]=K, IN[1]=flatten_3)  # IronPython2
# ---------- python_script.python (75 lines) ----------
# Enable Python support and load DesignScript library
import clr
clr.AddReference('ProtoGeometry')
from Autodesk.DesignScript.Geometry import *
clr.AddReference('DSCoreNodes')

from DSCore import *

def ClusterCentroid(points, centroid):
    numOfPoints = len(points)
    if (numOfPoints == 0):
        return centroid
    else:
        xAvg = sum( [p.X for p in points] ) / numOfPoints
        yAvg = sum( [p.Y for p in points] ) / numOfPoints
        zAvg = sum( [p.Z for p in points] ) / numOfPoints
        return Point.ByCoordinates(xAvg, yAvg, zAvg)

def RandomCentroids(k, points):
    xLst = [p.X for p in points]
    minX = min(xLst)
    maxX = max(xLst)

    yLst = [p.Y for p in points]
    minY = min(yLst)
    maxY = max(yLst)

    zLst = [p.Z for p in points]
    minZ = min(zLst)
    maxZ = max(zLst)

    centers = []
    for i in range(k):
        randX = Math.Random(minX, maxX)
        randY = Math.Random(minY, maxY)
        randZ = Math.Random(minZ, maxZ)
        center = Point.ByCoordinates( randX, randY, randZ)
        centers.append( center )

    return centers

def ClusterPoints(points, centroids):
    groups = []
    for centroid in centroids:
        group = []

        for point in points:
            nearestCentroid = sorted(centroids, key = lambda c: point.DistanceTo(c), reverse = False)[0]
            if centroid is nearestCentroid:
                group.append(point)
        
        groups.append(group)
    return groups


# INPUTS
k = IN[0]
points = IN[1]

epochs = 5
# MAIN
    #1. Init centroids
centroids = RandomCentroids(k, points)
    #2. Assign points to nearest centroids
clusters = ClusterPoints(points, centroids)
    #3. Move centers to assigned points


for i in range(epochs):

    centroids = [ClusterCentroid( cluster, centroid ) for cluster, centroid in zip(clusters, centroids)]
    clusters = ClusterPoints(points, centroids)


OUT = clusters, centroids
# ----------------------------------------
code_block_2 = CodeBlock(x=python_script) { x[0]; }
flatten_4 = List.Flatten(list=code_block_2)
eq_3 = flatten_3@L1 == flatten_4
code_block_3 = CodeBlock { true; }
indexOf = List.IndexOf(list=eq_3@L2, element=code_block_3)
sortByKey = List.SortByKey(list=maxPoint, keys=indexOf)
code_block_4 = CodeBlock(x=code_block_2) { x[0]; }
count = List.Count(list=code_block_4)
takeItems = List.TakeItems(list=sortByKey.sortedList, amount=count)
dropItems = List.DropItems(list=sortByKey.sortedList, amount=count)
list_create_2 = List.Create(item0=takeItems, item1=dropItems)
python_script_2 = Python(IN[0]=list_create_2)  # IronPython2
# ---------- python_script_2.python (22 lines) ----------
# Enable Python support and load DesignScript library
import clr
clr.AddReference('ProtoGeometry')
from Autodesk.DesignScript.Geometry import *
clr.AddReference('DSCoreNodes')
# clr.AddReference('ProtoGeometry')
# clr.ImportExtensions(Revit.GeometryConversion)
from DSCore import *
from Autodesk.DesignScript.Geometry import *
# The inputs to this node will be stored as a list in the IN variables.
clusters = IN[0]

output = []
# Place your code below this line
for cluster in clusters:
	r = Math.Random(0,255)
	g = Math.Random(0,255)
	b = Math.Random(0,255)
	randomColor = Color.ByARGB(100, r,g,b)
	output.append(randomColor)
	
OUT = output
# ----------------------------------------
byGeometryColor = Modifiers.GeometryColor.ByGeometryColor(geometry=list_create_2, color=python_script_2)
id = Element.Id(element=flatten_2)
sortByKey_2 = List.SortByKey(list=id, keys=indexOf)
code_block_5 = CodeBlock(x=code_block_2) { x[0]; }
count_2 = List.Count(list=code_block_5)
dropItems_2 = List.DropItems(list=sortByKey_2.sortedList, amount=count_2)
element_by_id = ElementById(Id=dropItems_2)
geometry_2 = Element.Geometry(element=element_by_id)
byGeometry_2 = BoundingBox.ByGeometry(geom=geometry_2)
maxPoint_2 = BoundingBox.MaxPoint(boundingBox=byGeometry_2)
Z = Point.Z(point=maxPoint_2)
sort = List.Sort(list=Z)
indexOf_2 = List.IndexOf(list=Z, element=sort)
reorder = List.Reorder(list=element_by_id, indices=indexOf_2)
id_2 = Element.Id(element=reorder)
file_path = Filename("새 폴더\st.csv")
takeItems_2 = List.TakeItems(list=sortByKey_2.sortedList, amount=count_2)
element_by_id_2 = ElementById(Id=takeItems_2)
geometry_3 = Element.Geometry(element=element_by_id_2)
byGeometry_3 = BoundingBox.ByGeometry(geom=geometry_3)
maxPoint_3 = BoundingBox.MaxPoint(boundingBox=byGeometry_3)
Z_2 = Point.Z(point=maxPoint_3)
sort_2 = List.Sort(list=Z_2)
indexOf_3 = List.IndexOf(list=Z_2, element=sort_2)
reorder_2 = List.Reorder(list=element_by_id_2, indices=indexOf_3)
uniqueId = Element.UniqueId(element=reorder_2)
code_block_6 = CodeBlock { ", "; }
add = uniqueId + code_block_6
restOfItems = List.RestOfItems(list=uniqueId)
add_2 = add + restOfItems
uniqueId_2 = Element.UniqueId(element=reorder)
code_block_7 = CodeBlock { ", "; }
add_3 = uniqueId_2 + code_block_7
restOfItems_2 = List.RestOfItems(list=uniqueId_2)
add_4 = add_3 + restOfItems_2
list_create_3 = List.Create(item0=add_2, item1=add_4)
flatten_5 = List.Flatten(list=list_create_3)
exportCSV = Data.ExportCSV(filePath=file_path, data=flatten_5)  # frozen
