# Dynamo graph 4_1_2_2_최종GUID쌍.dyn "3 Physical connections" (Dynamo 2.10.1.3976)
# packages: SteamNodes 1.2.4

file_path = Filename("새 폴더\edges.csv")
file_path_2 = Filename("새 폴더\features.csv")
importCSV = Data.ImportCSV(filePath=file_path_2)
code_block = CodeBlock(x=importCSV) { x[0]; }
element_by_id = ElementById(Id=code_block)
uniqueId = Element.UniqueId(element=element_by_id@L1)
code_block_2 = CodeBlock { ","; }
add = uniqueId + code_block_2
code_block_3 = CodeBlock { 0; }
getSurroundingElements = Custom[Tool.GetSurroundingElements](Elements=element_by_id, ElementCheck=element_by_id, Tolerance=code_block_3)  # package SteamNodes; Get Surrounding Elements by Categories, group them as List. Tolerance distance available.
uniqueId_2 = Element.UniqueId(element=getSurroundingElements)
code_block_4 = CodeBlock { 1; }
dropItems = List.DropItems(list=uniqueId_2@L2, amount=code_block_4)
add_2 = add + dropItems
uniqueItems = List.UniqueItems(list=add_2@L2)
flatten = List.Flatten(list=uniqueItems)
file_path_3 = Filename("새 폴더\st.csv")
boolean = BoolSelector(true)
importCSV_2 = Data.ImportCSV(filePath=file_path_3, transpose=boolean)
firstItem = List.FirstItem(list=importCSV_2@L2)
code_block_5 = CodeBlock { ","; }
add_3 = firstItem + code_block_5
lastItem = List.LastItem(list=importCSV_2@L2)
trimWhitespace = String.TrimWhitespace(string=lastItem)
add_4 = add_3 + trimWhitespace
join = List.Join(list0=flatten, list1=add_4)
exportCSV = Data.ExportCSV(filePath=file_path, data=join)
flatten_2 = List.Flatten(list=uniqueItems)
add_5 = add_3 + trimWhitespace
